# Grasshopper definition GH Generator.gh (Grasshopper 1.0.7)

# ---- group: Generation Parameters
# This is not utilized in all components yet, changing it may break discretization
vent_width_cm = Slider(0.4, range=0..1)
vent_dimensions_standard_deviation = Slider(0.2, range=0..1)
vent_length_cm = Slider(0.3, range=0..1)
room_dimensions_stdev = Slider(0, range=0..100)
room_length = Slider(5, range=0..100)
room_width = Slider(5, range=0..100)
room_height = Slider(2.5, range=0..5)
case = Slider(1, range=1..99)
fds_save_path = FilePath("/Users/bartutuncay/Desktop/ffd/out/batch11/fds/")
export_fds_file = BooleanToggle(False)
solid_resolution_cm = Slider(10, range=0..100)

# ----
geometry_generator = GhPythonScript(
    x=room_length,
    y=room_width,
    z=room_height,
    u=room_dimensions_stdev,
    v=solid_resolution_cm,
    w=vent_length_cm,
    s=vent_width_cm,
    xx=vent_dimensions_standard_deviation,
    xu=solid_resolution_cm,
    xv=case)  # -> out, a, b, c, d, e, f, l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; inputs x: Int32
# ---------- geometry_generator: Python ----------
import math
import Rhino.Geometry as rg
import random

origin = rg.Point3d(0,0,0)
    
#box corner
rx = abs(random.gauss(x,u*x/100))
while rx < 2: #minimum width 2m
    rx = abs(random.gauss(x,u*x/100))
rx = round(rx,1)    
ry = abs(random.gauss(y,u*y/100))
while ry < 2: # minimum width 2m
    ry = abs(random.gauss(y,u*y/100))
ry = round(ry,1)
    
while ry < 2 and rx/ry > 3: #no extra-long rooms
    ry = abs(random.gauss(y,u*y/100))
    
rz = abs(random.gauss(z,u*z/100))
while rz < 2.7 or rz > 5: #minimum ceiling height 2.7m, max 4m
    rz = abs(random.uniform(2.7,4))
rz = round(rz,1)
    
a = rg.Box(rg.Plane.WorldXY,(origin,(rg.Point3d(rx,ry,rz))))

#extended boundary, envelope thickness 0.3m
boundmesh = str(0)+","+str(rx)+","+str(0)+","+str(ry)+","+str(0)+","+str(rz)
#resolution
resx = int(rx/v*100)
resy = int(ry/v*100)
resz = int(rz/v*100)
b = (resx,resy,resz)
    
#surfaces
    
#wall picker: 0-floor, 1-lowXaxis, 2-highZaxis, 3-highXaxis, 4-lowZaxis, 5-ceiling
    
intwall = random.randint(1,5)
exhwall = random.randint(1,5)
while exhwall == intwall:
    exhwall = random.randint(1,5)
    
csvint = intwall
csvexh = exhwall
    
xdim = random.gauss(w,w*xx)
ydim = random.gauss(s,s*xx)
    
xdim = round(xdim,2)
ydim = round(ydim,2)
    
intx = random.uniform(xdim,rx-xdim)
inty = random.uniform(ydim,ry-ydim)
intz = random.uniform(max(xdim,ydim),rz-(max(xdim,ydim)))
    
intx = round(intx,2)
inty = round(inty,2)
intz = round(intz,2)
    
if intwall == 0:
    intz = 0
if intwall == 1:
    inty = 0
if intwall == 2:
    intx = rx
if intwall == 3:
    inty = ry
if intwall == 4:
    intx = 0
if intwall == 5:
    intz = rz
    
if intwall == 0 or intwall == 5:
    inti = rg.Point3d(intx-xdim,inty-ydim,intz)
    intj = rg.Point3d(intx+xdim,inty-ydim,intz)
    intk = rg.Point3d(intx-xdim,inty+ydim,intz)
    intl = rg.Point3d(intx+xdim,inty+ydim,intz)
elif intwall == 1 or intwall == 3:
    inti = rg.Point3d(intx-xdim,inty,intz-ydim)
    intj = rg.Point3d(intx+xdim,inty,intz-ydim)
    intk = rg.Point3d(intx-xdim,inty,intz+ydim)
    intl = rg.Point3d(intx+xdim,inty,intz+ydim)
elif intwall == 2 or intwall == 4:
    inti = rg.Point3d(intx,inty-ydim,intz-xdim)
    intj = rg.Point3d(intx,inty+ydim,intz-xdim)
    intk = rg.Point3d(intx,inty-ydim,intz+xdim)
    intl = rg.Point3d(intx,inty+ydim,intz+xdim)
    
if intwall == 5:
    intake = []
    for iix in range(int(rx/1.4)-1):
        for iiy in range(int(ry/1.4)-1):
            #create 60*60 squares, future addition: from middle of room
            iix = round(iix,2)
            iiy = round(iiy,2)
            inti = rg.Point3d(0.8+iix*1.5,0.8+iiy*1.5,intz)
            intj = rg.Point3d(1.4+iix*1.5,0.8+iiy*1.5,intz)
            intk = rg.Point3d(0.8+iix*1.5,1.4+iiy*1.5,intz)
            intl = rg.Point3d(1.4+iix*1.5,1.4+iiy*1.5,intz)
            
            intake.append(rg.Brep.CreateFromCornerPoints(inti,intj,intl,intk,0))
    print('multiple ceiling vents')
if intwall != 5:
    intake = rg.Brep.CreateFromCornerPoints(inti,intj,intl,intk,0)
c = intake
    
exdim = random.gauss(w,w*xx)
eydim = random.gauss(s,s*xx)
    
exdim = round(exdim,2)
eydim = round(eydim,2)
    
exhx = random.uniform(exdim,rx-exdim)
exhy = random.uniform(eydim,ry-eydim)
exhz = random.uniform(max(exdim,eydim),rz-(max(exdim,eydim)))
    
exhx = round(exhx,2)
exhy = round(exhy,2)
exhz = round(exhz,2)
    
if exhwall == 0:
    exhz = 0
if exhwall == 1:
    exhy = 0
if exhwall == 2:
    exhx = rx
if exhwall == 3:
    exhy = ry
if exhwall == 4:
    exhx = 0
if exhwall == 5:
    exhz = rz
    
if exhwall == 0 or exhwall == 5:
    exhi = rg.Point3d(exhx-exdim,exhy-eydim,exhz)
    exhj = rg.Point3d(exhx+exdim,exhy-eydim,exhz)
    exhk = rg.Point3d(exhx-exdim,exhy+eydim,exhz)
    exhl = rg.Point3d(exhx+exdim,exhy+eydim,exhz)
elif exhwall == 1 or exhwall == 3:
    exhi = rg.Point3d(exhx-exdim,exhy,exhz-eydim)
    exhj = rg.Point3d(exhx+exdim,exhy,exhz-eydim)
    exhk = rg.Point3d(exhx-exdim,exhy,exhz+eydim)
    exhl = rg.Point3d(exhx+exdim,exhy,exhz+eydim)
elif exhwall == 2 or exhwall == 4:
    exhi = rg.Point3d(exhx,exhy-eydim,exhz-exdim)
    exhj = rg.Point3d(exhx,exhy+eydim,exhz-exdim)
    exhk = rg.Point3d(exhx,exhy-eydim,exhz+exdim)
    exhl = rg.Point3d(exhx,exhy+eydim,exhz+exdim)
    
exhaust = rg.Brep.CreateFromCornerPoints(exhi,exhj,exhl,exhk,0)
d = exhaust
    
venttype = random.randint(0,3)
e = venttype
    
#temperatures
tempint = random.randint(16,32)
f = tempint
    
if tempint < 22:
    tsupply = 35
elif tempint > 26:
    tsupply = 12
else:
    tsupply = tempint
    
collision = []
    
#furniture: cabinets, kitchenettes, shelves

samplelist = [0,1,2,3]
#vent anti-collision: 1-lowZ, 2-highX, 3-highZ, 4-lowX
if intwall == 1 or exhwall == 1:
    list.remove(samplelist,0)
if intwall == 2 or exhwall == 2:
    list.remove(samplelist,1)
if intwall == 3 or exhwall == 3:
    list.remove(samplelist,2)
if intwall == 4 or exhwall == 4:
    list.remove(samplelist,3)
    
nr_furn = min(random.randint(1,3),len(samplelist)) #number of furniture objects
print(str(nr_furn)+' furniture objects')
    
furnwall = random.sample(samplelist,nr_furn)

csvfurn = nr_furn
    
f1 = []
    
for fi in range(nr_furn):
        
    #furniture adjacent wall: 0-lowZ, 1-highX, 2-highZ, 3-lowX
         
    if furnwall[fi] == 0:
        fr1 = rg.Point3d(random.uniform(0.6,rx-1.2),(random.uniform(0.4,0.6)),0)
        fr2 = rg.Point3d(rx-0.6, 0.1, random.uniform(0.6,2))
    elif furnwall[fi] == 1:
        fr1 = rg.Point3d((rx-random.uniform(0.4,0.6)),random.uniform(0.6,ry-1.2),0)
        fr2 = rg.Point3d(rx-0.1, ry-0.6, random.uniform(0.6,2))
    elif furnwall[fi] == 2:
        fr1 = rg.Point3d(random.uniform(0.6,rx-1.2),(ry-random.uniform(0.4,0.6)),0)
        fr2 = rg.Point3d(rx-0.6, ry-0.1, random.uniform(0.6,2))
    elif furnwall[fi] == 3:
        fr1 = rg.Point3d((random.uniform(0.4,0.6)),random.uniform(0.6,ry-1.2),0)
        fr2 = rg.Point3d(0.1, ry-0.6, random.uniform(0.6,2))

    if fr1 != None and fr2 != None:
        f1.append(rg.Box(rg.Plane.WorldXY,(fr1,fr2)))
        
    for pt in (fr1,fr2):
        for j in range(0,fi):
            if f1[j] != None:
                furnfurncol = rg.Box.Contains(f1[j],pt)
                if furnfurncol:
                    collision.append('furniture-furniture collision')
                    f1[j] = None
                    print('furniture-furniture collision for furniture '+str(j)+', removed furniture '+str(j))
    
    for pt in (exhi,exhj,exhl,exhk,inti,intj,intl,intk):
        if f1[fi] != None:
            furnventcol = rg.Box.Contains(f1[fi],pt)
            if furnventcol:
                collision.append('furniture-vent collision')
                f1[fi] = None
                print('furniture-vent collision for furniture '+str(i)+', removed furniture '+str(i))

##meeting room base case - variations with furniture
    
#desk
desktp = 1 #random.randint(1,2) #desk type: 1-meeting table, 2-individual
    
if desktp == 1:
    if rx/ry > 1:
        deskdir = 1
    else:
        deskdir = 2
    
    if deskdir == 1:
        d1x = random.uniform(1.2,rx/3)
        d1y = random.uniform(1.2,ry-3)
        d2x = random.uniform(1.5+d1x, max(d1x+1.5,rx-1.2))
        d2y = random.uniform(1.5+d1y, max(d1y+1.5,(min(rx,ry)-1.2)))
        
        print('desk type 1, long x-axis')
        
    if deskdir == 2:
        d1x = random.uniform(1.2,rx-3)
        d1y = random.uniform(1.2,ry/3)
        d2x = random.uniform(1.5+d1x, max(d1x+1.5,(min(rx,ry)-1.2)))
        d2y = random.uniform(1.5+d1y, max(d1y+1.5,ry-1.2))
        
        print('desk type 1, long y-axis')
        
    desktop = rg.Box(rg.Plane.WorldXY,(rg.Point3d(d1x,d1y,0.7),rg.Point3d(d2x,d2y,0.8)))
        
    deskl1 = rg.Box(rg.Plane.WorldXY,(rg.Point3d(d1x,d1y,0),rg.Point3d(d1x+0.1,d1y+0.1,0.7)))
    deskl2 = rg.Box(rg.Plane.WorldXY,(rg.Point3d(d1x,d2y,0),rg.Point3d(d1x+0.1,d2y-0.1,0.7)))
    deskl3 = rg.Box(rg.Plane.WorldXY,(rg.Point3d(d2x,d2y,0),rg.Point3d(d2x-0.1,d2y-0.1,0.7)))
    deskl4 = rg.Box(rg.Plane.WorldXY,(rg.Point3d(d2x,d1y,0),rg.Point3d(d2x-0.1,d1y+0.1,0.7)))
    desklegs = [deskl1,deskl2,deskl3,deskl4]
    
#chairs - on the long edge
c1 = [] #chairs
c2 = [] #seated occupants
c3 = [] #computers
    
if deskdir == 1:
    ccount = int((d2x-d1x)/0.9)
    print('chairs: '+str(ccount*2))
    for chair in range(ccount):
        c1.append(rg.Box(rg.Plane.WorldXY,(rg.Point3d(d1x+0.3+(0.8*chair),d1y-0.5,0),rg.Point3d(d1x+0.8+(0.8*chair),d1y,0.5))))
        c1.append(rg.Box(rg.Plane.WorldXY,(rg.Point3d(d1x+0.3+(0.8*chair),d1y-0.5,0.5),rg.Point3d(d1x+0.8+(0.8*chair),d1y-0.4,1))))
        c1.append(rg.Box(rg.Plane.WorldXY,(rg.Point3d(d1x+0.3+(0.8*chair),d2y+0.5,0),rg.Point3d(d1x+0.8+(0.8*chair),d2y,0.5))))
        c1.append(rg.Box(rg.Plane.WorldXY,(rg.Point3d(d1x+0.3+(0.8*chair),d2y+0.5,0.5),rg.Point3d(d1x+0.8+(0.8*chair),d2y+0.4,1))))
        c2.append(rg.Box(rg.Plane.WorldXY,(rg.Point3d(d1x+0.3+(0.8*chair),d2y+0.3,0.5),rg.Point3d(d1x+0.8+(0.8*chair),d2y+0.1,1.2))))
        c2.append(rg.Box(rg.Plane.WorldXY,(rg.Point3d(d1x+0.3+(0.8*chair),d1y-0.3,0.5),rg.Point3d(d1x+0.8+(0.8*chair),d1y-0.1,1.2))))
        c3.append(rg.Box(rg.Plane.WorldXY,(rg.Point3d(d1x+0.4+(0.8*chair),d2y-0.1,0.8),rg.Point3d(d1x+0.7+(0.8*chair),d2y-0.3,0.9))))
        c3.append(rg.Box(rg.Plane.WorldXY,(rg.Point3d(d1x+0.4+(0.8*chair),d1y+0.1,0.8),rg.Point3d(d1x+0.7+(0.8*chair),d1y+0.3,0.9))))
if deskdir == 2:
    ccount = int((d2y-d1y)/0.9)
    print('chairs: '+str(ccount*2))
    for chair in range(ccount):
        c1.append(rg.Box(rg.Plane.WorldXY,(rg.Point3d(d1x-0.5,d1y+0.3+(0.8*chair),0),rg.Point3d(d1x,d1y+0.8+(0.8*chair),0.5))))
        c1.append(rg.Box(rg.Plane.WorldXY,(rg.Point3d(d1x-0.5,d1y+0.3+(0.8*chair),0.5),rg.Point3d(d1x-0.4,d1y+0.8+(0.8*chair),1))))
        c1.append(rg.Box(rg.Plane.WorldXY,(rg.Point3d(d2x+0.5,d1y+0.3+(0.8*chair),0),rg.Point3d(d2x,d1y+0.8+(0.8*chair),0.5))))
        c1.append(rg.Box(rg.Plane.WorldXY,(rg.Point3d(d2x+0.5,d1y+0.3+(0.8*chair),0.5),rg.Point3d(d2x+0.4,d1y+0.8+(0.8*chair),1))))
        c2.append(rg.Box(rg.Plane.WorldXY,(rg.Point3d(d2x+0.3,d1y+0.3+(0.8*chair),0.5),rg.Point3d(d2x+0.1,d1y+0.8+(0.8*chair),1.2))))
        c2.append(rg.Box(rg.Plane.WorldXY,(rg.Point3d(d1x-0.3,d1y+0.3+(0.8*chair),0.5),rg.Point3d(d1x-0.1,d1y+0.8+(0.8*chair),1.2))))
        c3.append(rg.Box(rg.Plane.WorldXY,(rg.Point3d(d2x-0.1,d1y+0.4+(0.8*chair),0.8),rg.Point3d(d2x-0.3,d1y+0.7+(0.8*chair),0.9))))
        c3.append(rg.Box(rg.Plane.WorldXY,(rg.Point3d(d1x+0.1,d1y+0.4+(0.8*chair),0.8),rg.Point3d(d1x+0.3,d1y+0.7+(0.8*chair),0.9))))
    
csvchairs = ccount*2
    
#occupants - standing
occupantsm = random.randint(0,int(rx*ry/10))
print('standing occupants: '+str(occupantsm))
csvoccm = occupantsm
occm = []
    
for om in range(occupantsm):
    occdir = random.randint(1,2)
    omx1 = random.uniform(0.7,d1x-0.65)
    omx2 = random.uniform(d2x+0.25,rx-1.55)
    omy1 = random.uniform(0.8,d1y-0.65)
    omy2 = random.uniform(d2y+0.25,ry-1.55)
    omx = round(random.choice([omx1,omx2]),1)
    omy = round(random.choice([omy1,omy2]),1)
        
    if occdir == 1:
        occm.append(rg.Box(rg.Plane.WorldXY,(rg.Point3d(omx,omy,0),rg.Point3d(omx+0.2,omy+0.4,1.7))))
    if occdir == 2:
        occm.append(rg.Box(rg.Plane.WorldXY,(rg.Point3d(omx,omy,0),rg.Point3d(omx+0.4,omy+0.2,1.7))))
        
    for pnt in ([rg.Point3d(omx-0.2,omy-0.2,1),rg.Point3d(omx+0.2,omy+0.2,1),rg.Point3d(omx-0.2,omy+0.2,1),rg.Point3d(omx+0.2,omy-0.2,1)]):
        for oo in range(0,om):
            if occm[oo] != None: #random error: index out of range
                occpoccpcol = rg.Box.Contains(occm[oo],pnt)
                if occpoccpcol:
                    collision.append('standing occupant collision')
                    occm.remove(occm[oo])
                    print('occupant-occupant collision for occupant '+str(oo)+', removed occupant '+str(oo))
        
    print(omx,omy)
    
#occupants - seated
occupantsst = random.randint(0,ccount*2)
print('seated occupants: '+str(occupantsst))
occs = random.sample(c2,occupantsst)
csvoccs = occupantsst
    
#devices heat sources
compcount = random.randint(0,ccount*2)
comps = random.sample(c3,compcount)
print('computers on desk: '+str(compcount))
csvdevc = compcount
    
#heating
#type: 0-forced air, 1-radiator, 2-floor
htgtype = random.randint(0,2)

if tempint > 26:
    htgtype = None
    
rdwall2 = [0,1,2,3]
for fw in furnwall:
    list.remove(rdwall2,fw)
    
if htgtype == 1: #radiator
    rdwall = random.choice(rdwall2) #radiator adjacent wall: 0-lowZ, 1-highX, 2-highZ, 3-lowX
    tsupply = tempint
        
    if rdwall == 0:
        rc1 = rg.Point3d(random.uniform(0.1,rx-0.1),(random.uniform(0.2,0.4)),0.1)
        rc2 = rg.Point3d(rx-0.1, 0.1, random.uniform(0.3,1.5))
    elif rdwall == 1:
        rc1 = rg.Point3d((rx-random.uniform(0.2,0.4)),random.uniform(0.1,0.9*ry),0.1)
        rc2 = rg.Point3d(rx-0.1, ry-0.1, random.uniform(0.3,1.5))
    elif rdwall == 2:
        rc1 = rg.Point3d(random.uniform(0.1,0.9*rx),(ry-random.uniform(0.2,0.4)),0.1)
        rc2 = rg.Point3d(rx-0.1, ry-0.1, random.uniform(0.3,1.5))
    elif rdwall == 3:
        rc1 = rg.Point3d((random.uniform(0.2,0.4)),random.uniform(0.1,ry-0.1),0.1)
        rc2 = rg.Point3d(0.1, ry-0.1, random.uniform(0.3,1.5))
    radiator = rg.Box(rg.Plane.WorldXY,(rc1,rc2))
    rdsrf1 = rg.Point3d(rc1.X,rc1.Y,rc2.Z)
    rdsrf2 = rg.Point3d(rc2.X,rc1.Y,rc2.Z)
    rdsrf3 = rg.Point3d(rc2.X,rc2.Y,rc2.Z)
    rdsrf4 = rg.Point3d(rc1.X,rc2.Y,rc2.Z)
    radiatorsrf = rg.Brep.CreateFromCornerPoints(rdsrf1,rdsrf2,rdsrf3,rdsrf4,0)
    
print(collision)
    
#vent velocities
envelope = (rx+ry)*2*rz
uval = random.uniform(0.1,3)
    
tempext = random.randint(20,28)
if tempint < 22:
    tempext = random.randint(-10,22)
    heatloss = envelope*uval*abs(tempext-tempint)-(compcount*20)-((occupantsm+occupantsst)*60)
if tempint > 26:
    tempext = random.randint(26,40)
    heatloss = envelope*uval*abs(tempext-tempint)+(compcount*40)+((occupantsm+occupantsst)*115)
        
tcomp = tempint+3 #+3, mean 30 W heat release
toccs = tempint+3 #+4, mean 100 W heat release 
    
volroom = rx*ry*rz
    
if tempint < 22 or tempint > 26:
    if intwall != 5:
        hcflow = round(heatloss/(1.2*1005*abs(tsupply-tempint+0.01)*4*xdim*ydim),2)
    if intwall == 5:
        a_int = (int(rx/1.4)-1)*(int(ry/1.4)-1)*0.36
        hcflow = round(heatloss/(1.2*1005*abs(tsupply-tempint+0.01)*a_int),2)
    if htgtype == 2 or htgtype == 1:
        hcflow = 0
else:
    hcflow = 0
velocityin = max(0.0167/(4*xdim*ydim),hcflow) #minimum rate 16.7 L/s
    
l = tsupply
    
m = velocityin
    
velocityex = velocityin*((xdim*ydim)/(exdim*eydim))
k = velocityex
    
csvinta = (int(rx/1.4)-1)*(int(ry/1.4)-1)*0.36 if intwall == 5 else xdim*ydim
csvexha = exdim*eydim
# ---------- end geometry_generator ----------
geometry_output_log = Panel(geometry_generator.out)

# ---- group: Discretization
null_filter = GhPythonScript(x=geometry_generator.f1)  # -> out, a; inputs x: list
# ---------- null_filter: Python ----------
__author__ = "bartutuncay"

import rhinoscriptsyntax as rs

for i in x:
    if i == None:
        x.remove(i)

a = x
# ---------- end null_filter ----------
occupants = GhPythonScript(x=[geometry_generator.occm, geometry_generator.occs], y=solid_resolution_cm)  # -> out, flatten(a); inputs x: Box
# ---------- occupants: Python ----------
__author__ = "bartutuncay"

import rhinoscriptsyntax as rs
import math
import Rhino.Geometry as rg

bb = x.BoundingBox

bbc = rg.BoundingBox.GetCorners(bb)

bbr = []

for c in bbc:
    xval = round(c.X,1)
    yval = round(c.Y,1)
    zval = round(c.Z,1)
    
    bbr.append((xval,yval,zval))

bboxmax = max(bbr)
bboxmin = min(bbr)
xrange = bboxmax[0]-bboxmin[0]
yrange = bboxmax[1]-bboxmin[1]
zrange = bboxmax[2]-bboxmin[2]

xrangeint = int(round(xrange/y*100))
yrangeint = int(round(yrange/y*100))

zmin = round(bboxmin[2]+y/100,1)
zmax = round(bboxmax[2]+y/100,1)

cubes = []
arrayout = []

for i in range(xrangeint):
    xval1 = bboxmin[0]+i*y/100
    xval2 = bboxmin[0]+(1+i)*y/100
    
    for j in range(yrangeint):
        yval1 = bboxmin[1]+j*y/100
        yval2 = bboxmin[1]+(j+1)*y/100
        arrayout.append((xval1,xval2,yval1,yval2,zmin,zmax))
        cubes.append(rg.Box(rg.Plane.WorldXY,(rg.Point3d(xval1,yval1,bboxmin[2]),rg.Point3d(xval2,yval2,bboxmax[2]))))
print(xrange,yrange)
a = ("{:.1f},{:.1f},{:.1f},{:.1f},{:.1f},{:.1f}".format(bboxmin[0], bboxmax[0], bboxmin[1], bboxmax[1], bboxmin[2], bboxmax[2]))
c = cubes
# ---------- end occupants ----------
vents = GhPythonScript(x=geometry_generator.c, y=geometry_generator.e, z=geometry_generator.d)  # -> out, a, b, c, d, e; inputs x: list of Surface, y: Int32, z: Surface
# ---------- vents: Python ----------
__author__ = "bartutuncay"

import rhinoscriptsyntax as rs
import math
import Rhino.Geometry as rg

if y == 0:
    ventstr = "Linear"
if y == 1:
    ventstr = "Louvered"
if y == 2:
    ventstr = "Louvered Square"
if y == 3:
    ventstr = "Swirl"
b = ventstr

srfout = []

for vent in x:
    bb = rg.Surface.GetBoundingBox(vent,True)
    
    bbi = rg.BoundingBox.GetCorners(bb)
    
    xval2 = []
    yval2 = []
    zval2 = []
    
    for c in bbi:
        xval = c.X
        yval = c.Y
        zval = c.Z
        
        xval2.append(xval)
        yval2.append(yval)
        zval2.append(zval)
    
    srf = []
    
    if y == 0 or y == 1:
        srf = str(min(xval2))+","+str(max(xval2))+","+str(min(yval2))+","+str(max(yval2))+","+str(min(zval2))+","+str(max(zval2))
    
    if y == 2: #louvered square
        xmin = min(xval2)
        xmax = max(xval2)
        ymin = min(yval2)
        ymax = max(yval2)
        zmin = min(zval2)
        zmax = max(zval2)
        
        incr_x = (xmax-xmin)/6
        incr_y = (ymax-ymin)/6
        incr_z = (zmax-zmin)/6
        
        if incr_x == 0: #vent on X-axis wall
            srf.append(str(xmin)+","+str(xmin)+","+str(ymin)+","+str(ymin+incr_y)+","+str(zmin)+","+str(zmax)) #lowX full-height partition
            srf.append(str(xmin)+","+str(xmin)+","+str(ymin+incr_y)+","+str(ymax-incr_y)+","+str(zmin)+","+str(zmin+incr_z)) #lowY middle partition
            srf.append(str(xmin)+","+str(xmin)+","+str(ymin+incr_y)+","+str(ymax-incr_y)+","+str(zmin+incr_z)+","+str(zmin+(2*incr_z))) #low-midY middle partition
            srf.append(str(xmin)+","+str(xmin)+","+str(ymax-incr_y)+","+str(ymax)+","+str(zmin)+","+str(zmax)) #highX full-height partition
            srf.append(str(xmin)+","+str(xmin)+","+str(ymin+incr_y)+","+str(ymax-incr_y)+","+str(zmax-incr_z)+","+str(zmax)) #highY middle partition
            srf.append(str(xmin)+","+str(xmin)+","+str(ymin+incr_y)+","+str(ymax-incr_y)+","+str(zmax-(2*incr_z))+","+str(zmax-incr_z)) #high-midY middle partition
            srf.append(str(xmin)+","+str(xmin)+","+str(ymin+incr_y)+","+str(ymin+(2*incr_y))+","+str(zmin+(2*incr_z))+","+str(zmax-(2*incr_z))) #lowX middle partition
            srf.append(str(xmin)+","+str(xmin)+","+str(ymax-(2*incr_y))+","+str(ymax-incr_y)+","+str(zmin+(2*incr_z))+","+str(zmax-(2*incr_z))) #highX middle partition
            
        if incr_y == 0: #vent on Y-axis wall
            srf.append(str(xmin)+","+str(xmin+incr_x)+","+str(ymin)+","+str(ymin)+","+str(zmin)+","+str(zmax)) #lowX full-height partition
            srf.append(str(xmin+incr_x)+","+str(xmax-incr_x)+","+str(ymin)+","+str(ymin)+","+str(zmin)+","+str(zmin+incr_z)) #lowY middle partition
            srf.append(str(xmin+incr_x)+","+str(xmax-incr_x)+","+str(ymin)+","+str(ymin)+","+str(zmin+incr_z)+","+str(zmin+(2*incr_z))) #low-midY middle partition
            srf.append(str(xmax-incr_x)+","+str(xmax)+","+str(ymin)+","+str(ymin)+","+str(zmin)+","+str(zmax)) #highX full-height partition
            srf.append(str(xmin+incr_x)+","+str(xmax-incr_x)+","+str(ymin)+","+str(ymin)+","+str(zmax-incr_z)+","+str(zmax)) #highY middle partition
            srf.append(str(xmin+incr_x)+","+str(xmax-incr_x)+","+str(ymin)+","+str(ymin)+","+str(zmax-(2*incr_z))+","+str(zmax-incr_z)) #high-midY middle partition
            srf.append(str(xmin+incr_x)+","+str(xmin+(2*incr_x))+","+str(ymin)+","+str(ymin)+","+str(zmin+(2*incr_z))+","+str(zmax-(2*incr_z))) #lowX middle partition
            srf.append(str(xmax-(2*incr_x))+","+str(xmax-incr_x)+","+str(ymin)+","+str(ymin)+","+str(zmin+(2*incr_z))+","+str(zmax-(2*incr_z))) #highX middle partition
    
        if incr_z == 0: #vent on ceiling
            srf.append(str(xmin)+","+str(xmin+incr_x)+","+str(ymin)+","+str(ymax)+","+str(zmin)+","+str(zmin)) #lowX full-height partition
            srf.append(str(xmin+incr_x)+","+str(xmax-incr_x)+","+str(ymin)+","+str(ymin+incr_z)+","+str(zmin)+","+str(zmin)) #lowY middle partition
            srf.append(str(xmin+incr_x)+","+str(xmax-incr_x)+","+str(ymin+incr_y)+","+str(ymin+(2*incr_y))+","+str(zmin)+","+str(zmin)) #low-midY middle partition
            srf.append(str(xmax-incr_x)+","+str(xmax)+","+str(ymin)+","+str(ymax)+","+str(zmin)+","+str(zmin)) #highX full-height partition
            srf.append(str(xmin+incr_x)+","+str(xmax-incr_x)+","+str(ymax-incr_z)+","+str(ymax)+","+str(zmin)+","+str(zmin)) #highY middle partition
            srf.append(str(xmin+incr_x)+","+str(xmax-incr_x)+","+str(ymax-(2*incr_y))+","+str(ymax-incr_y)+","+str(zmin)+","+str(zmin)) #high-midY middle partition
            srf.append(str(xmin+incr_x)+","+str(xmin+(2*incr_x))+","+str(ymin+(2*incr_y))+","+str(ymax-(2*incr_y))+","+str(zmin)+","+str(zmin)) #lowX middle partition
            srf.append(str(xmax-(2*incr_x))+","+str(xmax-incr_x)+","+str(ymin+(2*incr_y))+","+str(ymax-(2*incr_y))+","+str(zmin)+","+str(zmin)) #highX middle partition
        
    if y == 3: #swirl
        xmin = min(xval2)
        xmax = max(xval2)
        ymin = min(yval2)
        ymax = max(yval2)
        zmin = min(zval2)
        zmax = max(zval2)
        
        incr_x = (xmax-xmin)/3
        incr_y = (ymax-ymin)/3
        incr_z = (zmax-zmin)/3
        
        if incr_x == 0: #vent on X-axis wall
            srf.append(str(xmin)+","+str(xmin)+","+str(ymin)+","+str(ymin+incr_y)+","+str(zmin)+","+str(zmin+incr_z)) #lowX-lowY partition
            srf.append(str(xmin)+","+str(xmin)+","+str(ymin)+","+str(ymin+incr_y)+","+str(zmin+incr_z)+","+str(zmax-incr_z)) #lowX middle partition
            srf.append(str(xmin)+","+str(xmin)+","+str(ymin)+","+str(ymin+incr_y)+","+str(zmax-incr_z)+","+str(zmax)) #lowX-highY partition
            srf.append(str(xmin)+","+str(xmin)+","+str(ymin+incr_y)+","+str(ymax-incr_y)+","+str(zmin)+","+str(zmin+incr_z)) #midX-lowY partition
            srf.append(str(xmin)+","+str(xmin)+","+str(ymin+incr_y)+","+str(ymax-incr_y)+","+str(zmax-incr_z)+","+str(zmax)) #midX-highY partition
            srf.append(str(xmin)+","+str(xmin)+","+str(ymax-incr_y)+","+str(ymax)+","+str(zmin)+","+str(zmin+incr_z)) #highX-lowY partition
            srf.append(str(xmin)+","+str(xmin)+","+str(ymax-incr_y)+","+str(ymax)+","+str(zmin+incr_z)+","+str(zmax-incr_z)) #highX-midY partition
            srf.append(str(xmin)+","+str(xmin)+","+str(ymax-incr_y)+","+str(ymax)+","+str(zmax-incr_z)+","+str(zmax)) #highX-highY partition
            
        if incr_y == 0: #vent on Y-axis wall
            srf.append(str(xmin)+","+str(xmin+incr_x)+","+str(ymin)+","+str(ymin)+","+str(zmin)+","+str(zmin+incr_z)) #lowX-lowY partition
            srf.append(str(xmin)+","+str(xmin+incr_x)+","+str(ymin)+","+str(ymin)+","+str(zmin+incr_z)+","+str(zmax-incr_z)) #lowX middle partition
            srf.append(str(xmin)+","+str(xmin+incr_x)+","+str(ymin)+","+str(ymin)+","+str(zmax-incr_z)+","+str(zmax)) #lowX-highY partition
            srf.append(str(xmin+incr_x)+","+str(xmax-incr_x)+","+str(ymin)+","+str(ymin)+","+str(zmin)+","+str(zmin+incr_z)) #midX-lowY partition
            srf.append(str(xmin+incr_x)+","+str(xmax-incr_x)+","+str(ymin)+","+str(ymin)+","+str(zmax-incr_z)+","+str(zmax)) #midX-highY  partition
            srf.append(str(xmax-incr_x)+","+str(xmax)+","+str(ymin)+","+str(ymin)+","+str(zmin)+","+str(zmin+incr_z)) #highX-lowY  partition
            srf.append(str(xmax-incr_x)+","+str(xmax)+","+str(ymin)+","+str(ymin)+","+str(zmin+incr_z)+","+str(zmax-incr_z)) #highX middle partition
            srf.append(str(xmax-incr_x)+","+str(xmax)+","+str(ymin)+","+str(ymin)+","+str(zmax-incr_z)+","+str(zmax)) #highX-highY  partition
    
        if incr_z == 0: #vent on ceiling
            srf.append(str(xmin)+","+str(xmin+incr_x)+","+str(ymin)+","+str(ymax)+","+str(zmin)+","+str(zmin)) #lowX full-height partition
            srf.append(str(xmin+incr_x)+","+str(xmax-incr_x)+","+str(ymin)+","+str(ymin+incr_z)+","+str(zmin)+","+str(zmin)) #lowY middle partition
            srf.append(str(xmin+incr_x)+","+str(xmax-incr_x)+","+str(ymin+incr_y)+","+str(ymin+(2*incr_y))+","+str(zmin)+","+str(zmin)) #low-midY middle partition
            srf.append(str(xmax-incr_x)+","+str(xmax)+","+str(ymin)+","+str(ymax)+","+str(zmin)+","+str(zmin)) #highX full-height partition
            srf.append(str(xmin+incr_x)+","+str(xmax-incr_x)+","+str(ymax-incr_z)+","+str(ymax)+","+str(zmin)+","+str(zmin)) #highY middle partition
            srf.append(str(xmin+incr_x)+","+str(xmax-incr_x)+","+str(ymax-(2*incr_y))+","+str(ymax-incr_y)+","+str(zmin)+","+str(zmin)) #high-midY middle partition
            srf.append(str(xmin+incr_x)+","+str(xmin+(2*incr_x))+","+str(ymin+(2*incr_y))+","+str(ymax-(2*incr_y))+","+str(zmin)+","+str(zmin)) #lowX middle partition
            srf.append(str(xmax-(2*incr_x))+","+str(xmax-incr_x)+","+str(ymin+(2*incr_y))+","+str(ymax-(2*incr_y))+","+str(zmin)+","+str(zmin)) #highX middle partition

    srfout.append(srf)

bb_e = rg.Surface.GetBoundingBox(z,True)

bbe = rg.BoundingBox.GetCorners(bb_e)

xval3 = []
yval3 = []
zval3 = []

for k in bbe:
    xval = k.X
    yval = k.Y
    zval = k.Z
    
    xval3.append(xval)
    yval3.append(yval)
    zval3.append(zval)

srf_e = str(min(xval3))+","+str(max(xval3))+","+str(min(yval3))+","+str(max(yval3))+","+str(min(zval3))+","+str(max(zval3))

a = srf
e = srfout
d = srf_e
# ---------- end vents ----------
furniture = GhPythonScript(x=[geometry_generator.desktop, geometry_generator.desklegs, null_filter.a, geometry_generator.c1], y=solid_resolution_cm)  # -> out, flatten(a); inputs x: Box; same code as occupants
radiator = GhPythonScript(x=geometry_generator.radiator, y=solid_resolution_cm)  # -> out, a, b, c, flatten(d); inputs x: Box
# ---------- radiator: Python ----------
__author__ = "bartutuncay"

import rhinoscriptsyntax as rs
import math
import Rhino.Geometry as rg

bb = x.BoundingBox

bbc = rg.BoundingBox.GetCorners(bb)

bbr = []

for c in bbc:
    xval = round(c.X,1)
    yval = round(c.Y,1)
    zval = round(c.Z,1)
    
    bbr.append((xval,yval,zval))

bboxmax = max(bbr)
bboxmin = min(bbr)
xrange = bboxmax[0]-bboxmin[0]
yrange = bboxmax[1]-bboxmin[1]
zrange = bboxmax[2]-bboxmin[2]

xrangeint = int(round(xrange/y*100))
yrangeint = int(round(yrange/y*100))

zmin = round(bboxmin[2]+y/100,1)
zmax = round(bboxmax[2]+y/100,1)

cubes = []
arrayout = []

for i in range(xrangeint):
    xval1 = bboxmin[0]+i*y/100
    xval2 = bboxmin[0]+(1+i)*y/100
    
    for j in range(yrangeint):
        yval1 = bboxmin[1]+j*y/100
        yval2 = bboxmin[1]+(j+1)*y/100
        arrayout.append((xval1,xval2,yval1,yval2,zmin,zmax))
        cubes.append(rg.Box(rg.Plane.WorldXY,(rg.Point3d(xval1,yval1,bboxmin[2]),rg.Point3d(xval2,yval2,bboxmax[2]))))
print(xrange,yrange)
b = rg.Brep.CreateFromCornerPoints(rg.Point3d(bboxmin[0],bboxmin[1],bboxmax[2]),rg.Point3d(bboxmin[0],bboxmax[1],bboxmax[2]),rg.Point3d(bboxmax[0],bboxmax[1],bboxmax[2]),rg.Point3d(bboxmax[0],bboxmin[1],bboxmax[2]),0)

a = arrayout
c = cubes
d = [(bboxmin[0],bboxmax[0],bboxmin[1],bboxmax[1],bboxmin[2],bboxmax[2])]
d = ("{:.1f},{:.1f},{:.1f},{:.1f},{:.1f},{:.1f}".format(bboxmin[0], bboxmax[0], bboxmin[1], bboxmax[1], bboxmin[2], bboxmax[2]))
# ---------- end radiator ----------
envelope = GhPythonScript(
    x=geometry_generator.a,
    y=solid_resolution_cm,
    z=geometry_generator.uval,
    u=geometry_generator.tempext,
    v=geometry_generator.f)  # -> out, a, b, t, f; inputs x: Box
# ---------- envelope: Python ----------
__author__ = "bartutuncay"

import math
import Rhino.Geometry as rg

bb = x.BoundingBox

bbc = rg.BoundingBox.GetCorners(bb)

bbr = []

for c in bbc:
    xval = round(c.X,1)
    yval = round(c.Y,1)
    zval = round(c.Z,1)
    
    bbr.append((xval,yval,zval))

cond = z*0.3
b = cond

R = 0.3/cond
Rtot = 0.04+R+0.125
T_intsrf = u+((0.04+R)/Rtot*(v-u))
t = T_intsrf

bboxmax = max(bbr)
bboxmin = min(bbr)
xrange = bboxmax[0]-bboxmin[0]
yrange = bboxmax[1]-bboxmin[1]
zrange = bboxmax[2]-bboxmin[2]

xrangeint = int(round(xrange/y*100))
yrangeint = int(round(yrange/y*100))

zmin = round(bboxmin[2]+y/100,1)
zmax = round(bboxmax[2]+y/100,1)

cubes = []
arrayout = []

print(xrange,yrange,zrange)
wall = []

wall.append('0,0,'+str(bboxmin[1])+','+str(bboxmax[1])+','+str(bboxmin[2])+','+str(bboxmax[2])) #lowX
wall.append(str(bboxmax[0])+','+str(bboxmax[0])+','+str(bboxmin[1])+','+str(bboxmax[1])+','+str(bboxmin[2])+','+str(bboxmax[2])) #highX
wall.append(str(bboxmin[0])+','+str(bboxmax[0])+',0,0,'+str(bboxmin[2])+','+str(bboxmax[2])) #lowY
wall.append(str(bboxmin[0])+','+str(bboxmax[0])+','+str(bboxmax[1])+','+str(bboxmax[1])+','+str(bboxmin[2])+','+str(bboxmax[2])) #highY
f = (str(bboxmin[0])+','+str(bboxmax[0])+','+str(bboxmin[1])+','+str(bboxmax[1])+',0,0')

a = wall
# ---------- end envelope ----------
computers = GhPythonScript(x=geometry_generator.comps, y=solid_resolution_cm)  # -> out, d; inputs x: Box; same code as radiator

# ----
fds_export_2 = GhPythonScript(
    exportbool=export_fds_file,
    CHID=case,
    filepath=fds_save_path,
    T_room=geometry_generator.f,
    boundary=geometry_generator.boundmesh,
    IJK=geometry_generator.b,
    furnitures=furniture.a,
    radiators=radiator.d,
    occupants=occupants.a,
    devices=computers.d,
    inletsrf=vents.e,
    exhaustsrf=vents.d,
    venttype=geometry_generator.e,
    T_vent=geometry_generator.l,
    v_inlet=geometry_generator.m,
    v_exhaust=geometry_generator.k,
    ventstr=vents.b,
    envelope=envelope.a,
    uvalue=envelope.b,
    T_intsrf=envelope.t,
    htgtype=geometry_generator.htgtype,
    floor=envelope.f,
    T_comp=geometry_generator.tcomp,
    T_occ=geometry_generator.toccs)  # -> out, a; inputs exportbool: Boolean, CHID: Int32, IJK: list, furnitures: list, radiators: list, occupants: list, devices: list, inletsrf: list, envelope: list
# ---------- fds_export_2: Python ----------
__author__ = "bartutuncay"

import Rhino.Geometry as rg
import math
import os

new_rows = [
    "&HEAD TITLE='Case: "+str(CHID)+", Vent Type:"+str(ventstr)+"', CHID = '"+str(CHID)+"' /",
    "&MISC TMPA = "+str(T_room)+" /",
    "&TIME T_END=600/",
    "&DUMP NFRAMES = 60,PLOT3D_QUANTITY(1:5)='TEMPERATURE','U-VELOCITY','V-VELOCITY','W-VELOCITY','PRESSURE',DT_PL3D=1000,RAMP_SL3D='b-ramp',WRITE_XYZ=T/",
    "&RAMP ID='b-ramp', T=0 /",
#    "&RAMP ID='b-ramp', T=60 /",
    "&RAMP ID='b-ramp', T=120 /",
#    "&RAMP ID='b-ramp', T=180 /",
    "&RAMP ID='b-ramp', T=240 /",
#    "&RAMP ID='b-ramp', T=300 /",
#    "&RAMP ID='b-ramp', T=360 /",
#    "&RAMP ID='b-ramp', T=420 /",
    "&RAMP ID='b-ramp', T=480 /",
#    "&RAMP ID='b-ramp', T=490 /",
#    "&RAMP ID='b-ramp', T=500 /",
#    "&RAMP ID='b-ramp', T=510 /",
#    "&RAMP ID='b-ramp', T=520 /",
#    "&RAMP ID='b-ramp', T=530 /",
#    "&RAMP ID='b-ramp', T=540 /",
#    "&RAMP ID='b-ramp', T=550 /",
#    "&RAMP ID='b-ramp', T=560 /",
    "&RAMP ID='b-ramp', T=570 /",
    "&RAMP ID='b-ramp', T=580 /",
    "&RAMP ID='b-ramp', T=590 /",
    "&RAMP ID='b-ramp', T=600 /"]

#for sec in range(570,600):
#    new_rows.append("&RAMP ID='b-ramp', T="+str(sec)+" /")

new_rows.append("&MESH XB = "+str(boundary)+", IJK="+str(IJK[0])+","+str(IJK[1])+","+str(IJK[2])+" /")

if furnitures != None:
    for mesh in furnitures:
        new_rows.append("&OBST XB = "+str(mesh)+", COLOR = 'BLUE', SURF_ID = 'INERT' /")

if radiators:
    new_rows.append("&SURF ID = 'radiator_top' , TMP_FRONT = 55 /")
    new_rows.append("&OBST XB = "+str(radiators[0])+", COLOR = 'WHITE', SURF_ID = 'radiator_top' /")

if htgtype == 2:
    new_rows.append("&SURF ID = 'floor_heating', TMP_FRONT = 35 /")
    new_rows.append("&OBST XB = "+str(floor)+", COLOR = 'WHITE', SURF_ID = 'floor_heating' /")

for wall in range(len(envelope)):
    new_rows.append("&SURF ID='WALL "+str(wall)+"', TMP_FRONT = "+str(T_intsrf)+" /")
    new_rows.append("&OBST XB = "+str(envelope[wall])+", SURF_ID = 'WALL "+str(wall)+"' /")

#occupants and devices -- TODO: use heat (W) for devices, assign occupants material, add TMP_BACK
if devices != None:
    for device in range(len(devices)):
        new_rows.append("&SURF ID = 'computer "+str(device)+"', TMP_FRONT = "+str(T_comp)+" /")
        new_rows.append("&OBST XB = "+str(devices[device])+", COLOR = 'WHITE', SURF_ID = 'computer "+str(device)+"' /")
    
if occupants != None:
    for occupant in range(len(occupants)):
        new_rows.append("&SURF ID = 'occupant "+str(occupant)+"' , TMP_FRONT = "+str(T_occ)+" /")
        new_rows.append("&OBST XB = "+str(occupants[occupant])+", COLOR = 'RED', SURF_ID = 'occupant "+str(occupant)+"' /")

#inlet and exhaust vents -- TODO: use 'OPEN' for exhaust (door)
#new_rows.append("&VENT XB="+str(exhaustsrf)+", COLOR='RED',SURF_ID='exhaust' /") #predefined exhaust
new_rows.append("&VENT XB="+str(exhaustsrf)+", COLOR='RED',SURF_ID='OPEN' /") #exhaust as one-way pressure relief

for vent in range(len(inletsrf)):
    if venttype == 0: #linear
        new_rows.append("&VENT XB="+str(inletsrf[vent])+", COLOR='GREEN',SURF_ID='supply "+str(vent)+"' /")
        new_rows.append("&SURF ID='supply "+str(vent)+"', VEL=-"+str(v_inlet)+",TMP_FRONT= "+str(T_vent)+" /")
    
    if venttype == 1: #louvered
        new_rows.append("&VENT XB="+str(inletsrf[vent])+", COLOR='GREEN',SURF_ID='supply "+str(vent)+"' /")
        v1 = v_inlet/math.sin(math.pi/4)
        new_rows.append("&SURF ID='supply "+str(vent)+"', VEL=-"+str(v_inlet)+", VEL_T=0,"+str(v1)+",TMP_FRONT= "+str(T_vent)+" /")
    
    if venttype == 2: #radial, subdivision by 6*6 grid
        v1 = v_inlet/math.sin(math.pi/4)
        new_rows.append("&VENT XB="+str(inletsrf[vent][0])+", COLOR='GREEN',SURF_ID='supply "+str(vent)+"_1' /")
        new_rows.append("&VENT XB="+str(inletsrf[vent][1])+", COLOR='GREEN',SURF_ID='supply "+str(vent)+"_2' /")
        new_rows.append("&VENT XB="+str(inletsrf[vent][2])+", COLOR='GREEN',SURF_ID='supply "+str(vent)+"_3' /")
        new_rows.append("&VENT XB="+str(inletsrf[vent][3])+", COLOR='GREEN',SURF_ID='supply "+str(vent)+"_4' /")
        new_rows.append("&VENT XB="+str(inletsrf[vent][4])+", COLOR='GREEN',SURF_ID='supply "+str(vent)+"_5' /")
        new_rows.append("&VENT XB="+str(inletsrf[vent][5])+", COLOR='GREEN',SURF_ID='supply "+str(vent)+"_6' /")
        new_rows.append("&VENT XB="+str(inletsrf[vent][6])+", COLOR='GREEN',SURF_ID='supply "+str(vent)+"_7' /")
        new_rows.append("&VENT XB="+str(inletsrf[vent][7])+", COLOR='GREEN',SURF_ID='supply "+str(vent)+"_8' /")
        
        v1 = v_inlet*math.sin(math.pi/4)
        new_rows.append("&SURF ID='supply "+str(vent)+"_1', VEL=-"+str(v_inlet)+", VEL_T="+str(-v1)+",0, TMP_FRONT="+str(T_vent)+" /") #1
        new_rows.append("&SURF ID='supply "+str(vent)+"_2', VEL=-"+str(v_inlet)+", VEL_T= 0,"+str(-v1)+", TMP_FRONT="+str(T_vent)+" /") #4
        new_rows.append("&SURF ID='supply "+str(vent)+"_3', VEL=-"+str(v_inlet)+", VEL_T= 0,"+str(-v1)+", TMP_FRONT="+str(T_vent)+" /") #8
        new_rows.append("&SURF ID='supply "+str(vent)+"_4', VEL=-"+str(v_inlet)+", VEL_T="+str(v1)+",0, TMP_FRONT="+str(T_vent)+" /") #3
        new_rows.append("&SURF ID='supply "+str(vent)+"_5', VEL=-"+str(v_inlet)+", VEL_T= 0,"+str(v1)+", TMP_FRONT="+str(T_vent)+" /") #2
        new_rows.append("&SURF ID='supply "+str(vent)+"_6', VEL=-"+str(v_inlet)+", VEL_T= 0,"+str(v1)+", TMP_FRONT="+str(T_vent)+" /") #6
        new_rows.append("&SURF ID='supply "+str(vent)+"_7', VEL=-"+str(v_inlet)+", VEL_T="+str(-v1)+",0, TMP_FRONT="+str(T_vent)+" /") #5
        new_rows.append("&SURF ID='supply "+str(vent)+"_8', VEL=-"+str(v_inlet)+", VEL_T="+str(v1)+",0, TMP_FRONT="+str(T_vent)+" /") #7
    
    if venttype == 3: #spiral, subdivision by 3*3 grid
        v1 = v_inlet/math.sin(math.pi/4)
        v2 = v1*(2**0.5)
        new_rows.append("&VENT XB="+str(inletsrf[vent][0])+", COLOR='GREEN',SURF_ID='supply "+str(vent)+"_1' /")
        new_rows.append("&VENT XB="+str(inletsrf[vent][1])+", COLOR='GREEN',SURF_ID='supply "+str(vent)+"_2' /")
        new_rows.append("&VENT XB="+str(inletsrf[vent][2])+", COLOR='GREEN',SURF_ID='supply "+str(vent)+"_3' /")
        new_rows.append("&VENT XB="+str(inletsrf[vent][3])+", COLOR='GREEN',SURF_ID='supply "+str(vent)+"_4' /")
        new_rows.append("&VENT XB="+str(inletsrf[vent][4])+", COLOR='GREEN',SURF_ID='supply "+str(vent)+"_5' /")
        new_rows.append("&VENT XB="+str(inletsrf[vent][5])+", COLOR='GREEN',SURF_ID='supply "+str(vent)+"_6' /")
        new_rows.append("&VENT XB="+str(inletsrf[vent][6])+", COLOR='GREEN',SURF_ID='supply "+str(vent)+"_7' /")
        new_rows.append("&VENT XB="+str(inletsrf[vent][7])+", COLOR='GREEN',SURF_ID='supply "+str(vent)+"_8' /")
        
        new_rows.append("&SURF ID='supply "+str(vent)+"_1', VEL=-"+str(v_inlet)+", VEL_T="+str(-v2)+","+str(-v2)+", TMP_FRONT="+str(T_vent)+" /") #1
        new_rows.append("&SURF ID='supply "+str(vent)+"_2', VEL=-"+str(v_inlet)+", VEL_T= "+str(-v1)+",0, TMP_FRONT="+str(T_vent)+" /") #4
        new_rows.append("&SURF ID='supply "+str(vent)+"_3', VEL=-"+str(v_inlet)+", VEL_T= "+str(-v2)+","+str(v2)+", TMP_FRONT="+str(T_vent)+" /") #8
        new_rows.append("&SURF ID='supply "+str(vent)+"_4', VEL=-"+str(v_inlet)+", VEL_T=0,"+str(-v1)+", TMP_FRONT="+str(T_vent)+" /") #3
        new_rows.append("&SURF ID='supply "+str(vent)+"_5', VEL=-"+str(v_inlet)+", VEL_T= 0,"+str(v1)+", TMP_FRONT="+str(T_vent)+" /") #2
        new_rows.append("&SURF ID='supply "+str(vent)+"_6', VEL=-"+str(v_inlet)+", VEL_T= "+str(v2)+","+str(-v2)+", TMP_FRONT="+str(T_vent)+" /") #6
        new_rows.append("&SURF ID='supply "+str(vent)+"_7', VEL=-"+str(v_inlet)+", VEL_T="+str(v1)+",0, TMP_FRONT="+str(T_vent)+" /") #5
        new_rows.append("&SURF ID='supply "+str(vent)+"_8', VEL=-"+str(v_inlet)+", VEL_T="+str(v2)+","+str(v2)+", TMP_FRONT="+str(T_vent)+" /") #7

#new_rows.append("&SURF ID='exhaust', VEL="+str(v_exhaust)+" /") #predefined exhaust vent: properties

#slices and tail -- TODO: match slice to object centroid
new_rows.append("&SLCF XB = "+str(boundary)+", QUANTITY='VELOCITY', VECTOR= .TRUE./")
new_rows.append("&SLCF XB = "+str(boundary)+", QUANTITY='TEMPERATURE', VECTOR= .TRUE./")
new_rows.append("&SLCF XB = "+str(boundary)+", QUANTITY='PRESSURE', VECTOR= .TRUE./")
new_rows.append("&SLCF XB = "+str(boundary)+", QUANTITY='U-VELOCITY', VECTOR= .TRUE./")
new_rows.append("&SLCF XB = "+str(boundary)+", QUANTITY='V-VELOCITY', VECTOR= .TRUE./")
new_rows.append("&SLCF XB = "+str(boundary)+", QUANTITY='W-VELOCITY', VECTOR= .TRUE./")

new_rows.append("&TAIL /")

#write to file
if exportbool == True:
    folder_path = os.path.join(filepath, str(CHID))
    if not os.path.exists(folder_path):
        os.makedirs(folder_path)
    file_path = os.path.join(folder_path, str(CHID))
    file_path_2 = file_path+'.fds'
    
    with open(file_path_2, 'w') as file:
        file.write('\n'.join(new_rows) + '\n')
    
    # Optional: Print a success message with the new file path
    print("Exported new file to:", file_path_2)
# ---------- end fds_export_2 ----------
